# Grasshopper definition test_gates.gh (Grasshopper 1.0.7)
# plug-ins: Dynamic Data Tools

panel = Panel("""True
False
True
False""")
panel_2 = Panel("""True
False
True
False""")
panel_3 = Panel("""False
False
True
False""")
panel_4 = Panel("""True
False
False
False""")
flatten = FlattenTree(Tree=panel, Path="{3}")
flatten_2 = FlattenTree(Tree=panel_2, Path="{2;1}")
flatten_3 = FlattenTree(Tree=panel_3, Path="{1}")
flatten_4 = FlattenTree(Tree=panel_4, Path="{0;45}")
merge = Merge(Data1=flatten_3, Data2=flatten_2, Data3=flatten, Data4=flatten_4)
panel_5 = Panel(merge)
boolean_gate = BooleanGate(Bool=merge)
boolean_gate_2 = BooleanGate(Bool=Slider(0, range=0..10))
rec = DataRecorder(boolean_gate, DataLimit=-10, RecordData=True)
rec_2 = DataRecorder(boolean_gate_2, DataLimit=-10, RecordData=True)
panel_6 = Panel(rec)
panel_7 = Panel(rec_2)
